% Simulink data dictionary plantParams.sldd

vehicleParams = Simulink.Parameter(struct(mass_kg=18, area_m2=0.018, cg_m=1.811786, inertia_kgm2=[0.053 0 0; 0 8.41 0; 0 0 8.41]))
icParams = Simulink.Parameter(struct(velBdy_mps=[0.001 0 0], rateBdy_rps=[0 0 0], posNed_m=[0 0 0], eul_rad=[2.35369 1.429493 2.358699]))
envParams = Simulink.Parameter(struct(gravityNed_mps2=[0 0 9.81], lon_deg=-87.67671, lat_deg=42.05694, groundAlt_m=182, date_y=2026.666))
windParams = Simulink.Parameter(struct(type=0, constantNed_mps=[10; 0; 0]))

aeroParams = Simulink.Parameter(struct(
  machBreakpoints_na=[0.1 0.2 0.3 0.4 0.5 0.6 0.7 0.8 0.9 1],
  aoaBreakpoints_deg=[0 2 4],
  controlBreakpoints_deg=[-4 -2 0 2 4],
  CpBase_m=[0.4291085 0.6731775 0.8208534
   0.4291085 0.6731775 0.8208534
   0.4291085 0.6731775 0.8208534
   0.4291085 0.6731775 0.8208534
   0.4291085 0.6731775 0.8208534
   0.4291085 0.6731775 0.8208534
   0.4291085 0.6731775 0.8208534
   0.4291085 0.6731775 0.8208534
   0.4291085 0.6731775 0.8208534
   0.3272035 0.6183642 0.786919],
  CaBase_na=[0.301 0.301 0.302
   0.3 0.301 0.302
   0.3 0.3 0.301
   0.299 0.3 0.301
   0.299 0.3 0.301
   0.299 0.299 0.3
   0.298 0.299 0.3
   0.298 0.298 0.3
   0.298 0.298 0.299
   0.415 0.415 0.417],
  CnBase_na=[0 0.109 0.27
   0 0.109 0.27
   0 0.109 0.27
   0 0.109 0.27
   0 0.109 0.27
   0 0.109 0.27
   0 0.109 0.27
   0 0.109 0.27
   0 0.109 0.27
   0 0.101 0.255],
  CnFin_na=reshape([-0.01925 -0.01925 -0.01925 -0.01925 -0.01925 -0.01925 -0.01925 -0.01925 -0.01925 -0.0164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], 10, 3, 5),
  CaFin_na=reshape([0.034675 0.035175 0.0352 0.036725 0.037275 0.037825 0.0404 0.042 0.044125 0.041475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], 10, 3, 5),
  finCP1_m=[2.667005; 0.1270003; 0],
  finCP2_m=[2.667005; 0; 0.1270003],
  finCP3_m=[2.667005; -0.1270003; 0],
  finCP4_m=[2.667005; 0; -0.1270003],
  finAngles1_rad=[0 0 0],
  finAngles2_rad=[1.570796 0 0],
  finAngles3_rad=[3.141593 0 0],
  finAngles4_rad=[4.712389 0 0]))

sensorParams = Simulink.Parameter(struct(
  imuPosBdy_m=[0 0 0],
  accScaleCoupling_na=[1 0 0; 0 1 0; 0 0 1],
  accPSDWhite=[5.413280625e-7 5.413280625e-7 5.413280625e-7],
  accTau_s=200,
  accSigmaBias_mps2=[0.001962 0.001962 0.001962],
  accPSDGM=[3.849444e-08 3.849444e-08 3.849444e-08],
  accTurnOnBias_mps2=[-0.02565684 -0.02565684 -0.02565684],
  accSampleTime_s=0.01,
  gyroScaleCoupling_na=[1 0 0; 0 1 0; 0 0 1],
  gyroPSDWhite=[3.730156e-11 3.730156e-11 3.730156e-11],
  gyroTau_s=2000,
  gyroSigmaBias_rps=[0.0004848 0.0004848 0.0004848],
  gyroPSDGM=[2.35031e-10 2.35031e-10 2.35031e-10],
  gyroSigmaBiasTurnOn_rps=[0.009 0.009 0.009],
  gyroSampleTime_s=0.01,
  gyroG=[8.89716e-05 0 0; 0 8.89716e-05 0; 0 0 8.89716e-05],
  gyroTurnOnBias_rps=[-0.003902328 -0.003902328 -0.003902328],
  magSI=[1.08 0.05 -0.03; 0.04 0.93 0.02; -0.03 0.02 1.05],
  magBiasHIBdy_nT=[1200 -800 500],
  magPSDWhite=[196 196 196],
  magSampleTime_s=0.01,
  baroPSDWhite=0.0004,
  baroBiasTurnOn_Pa=40,
  baroTau_s=500,
  baroPSDGM=0.144,
  baroSampleTime_s=0.01))